# Grasshopper definition Spin rotation.gh (Grasshopper 1.0.7)

Y = Slider(20, range=0..20)
X = Slider(20, range=0..20)
radius = Slider(5, range=1..5)
count = Slider(100, range=0..100)
Y_2 = GetNumber(Y, AtLeast=1, AtMost=2147483647, Maximum=1.797693135e+308, Minimum=-1.797693135e+308)
count_2 = GetNumber(count, AtLeast=1, AtMost=2147483647, Maximum=1.797693135e+308, Minimum=-1.797693135e+308)
radius_2 = GetNumber(radius, AtLeast=1, AtMost=2147483647, Maximum=1.797693135e+308, Minimum=-1.797693135e+308)
X_2 = GetNumber(X, AtLeast=1, AtMost=2147483647, Maximum=1.797693135e+308, Minimum=-1.797693135e+308)
rectangle = Rectangle(Plane=PlaneXY(0, 0, 0), XSize=X_2, YSize=Y_2, Radius=0)  # -> Rectangle, Length
md_slider = MDSlider(SliderMode=0, slider_value=Point(0.5, 0.5, 0.5), x_domain=Domain(0, 1), y_domain=Domain(0, 1), z_domain=Domain(0, 1))
evaluate_surface = EvaluateSurface(Surface=reparameterize(rectangle.Rectangle), Point=md_slider)  # -> Point, Normal, UDirection, VDirection, Frame
circle = Circle(Plane=evaluate_surface.Point, Radius=radius_2)
divide_curve = DivideCurve(Curve=circle, Count=count_2, Kinks=False)  # -> Points, Tangents, Parameters
point_charge = PointCharge(Point=evaluate_surface.Point, Charge=Slider(0.4, range=0..1), Decay=Slider(1.1, range=0..10), Bounds=rectangle.Rectangle)
spin_force = SpinForce(
    Plane=evaluate_surface.Point,
    Strength=Slider(0.2, range=0..1),
    Radius=Slider(5.5, range=0..10),
    Decay=Slider(1.6, range=0..10),
    Bounds=rectangle.Rectangle)
merge_fields = MergeFields(Fields=[point_charge, spin_force])
field_line = FieldLine(Field=merge_fields, Point=divide_curve.Points, Steps=1000, Accuracy=0.1, Method=3)
divide_curve_2 = DivideCurve(Curve=field_line, Count=10, Kinks=False)  # -> Points, Tangents, Parameters
interpolate = Interpolate(Vertices=divide_curve_2.Points, Degree=3, Periodic=False, KnotStyle=1)  # -> Curve, Length, Domain
unit_z = UnitZ(Factor=Slider(0.3, range=0..1))
extrude = Extrude(Base=interpolate.Curve, Direction=unit_z)
curvepoint = PointOnCurve(extrude, parameter=0.5)
pt = ConstructPoint(XCoordinate=0, YCoordinate=0, ZCoordinate=0)
pull = PullPoint(Point=curvepoint, Geometry=pt, ClosestOnly=True)  # -> ClosestPoint, Distance
bnd = Bounds(Numbers=pull.Distance)
remap = RemapNumbers(Value=pull.Distance, Source=bnd, Target=Domain(0, 1))  # -> Mapped, Clipped
gradient = Gradient(
    LowerLimit=0,
    UpperLimit=1,
    Parameter=remap.Mapped,
    stops=[0: RGB(243, 57, 0), 0.1: RGB(236, 27, 60), 0.2: RGB(210, 0, 118), 0.3: RGB(103, 0, 120), 0.4: RGB(39, 72, 161), 0.5: RGB(1, 192, 229), 0.6: RGB(18, 178, 90), 0.7: RGB(79, 186, 8), 0.8: RGB(220, 237, 32), 0.9: RGB(247, 159, 20), 1: RGB(243, 57, 0)])
c_script = CSharpScript(crv=extrude, color=gradient)  # -> out, A; inputs crv: Curve, color: Color
# ---------- c_script: C# ----------
    var c = color.R + "," + color.G + "," + color.B;
    crv.SetUserString("color", c);
    A = crv;
# ---------- end c_script ----------

# ---- group: RH_OUT:edges
curve = Curve(flatten(c_script.A))
