# Grasshopper definition spin rotation.gh (Grasshopper 1.0.7)

Y = Slider(20, range=0..20)
X = Slider(20, range=0..20)
radius = Slider(5, range=1..5)
count = Slider(100, range=0..100)
Y_2 = GetNumber(Y, AtLeast=1, AtMost=2147483647, Maximum=1.797693135e+308, Minimum=-1.797693135e+308)
count_2 = GetNumber(count, AtLeast=1, AtMost=2147483647, Maximum=1.797693135e+308, Minimum=-1.797693135e+308)
radius_2 = GetNumber(radius, AtLeast=1, AtMost=2147483647, Maximum=1.797693135e+308, Minimum=-1.797693135e+308)
X_2 = GetNumber(X, AtLeast=1, AtMost=2147483647, Maximum=1.797693135e+308, Minimum=-1.797693135e+308)
rectangle = Rectangle(Plane=PlaneXY(0, 0, 0), XSize=X_2, YSize=Y_2, Radius=0)  # -> Rectangle, Length
md_slider = MDSlider(SliderMode=0, slider_value=Point(0.5, 0.5, 0.5), x_domain=Domain(0, 1), y_domain=Domain(0, 1), z_domain=Domain(0, 1))
evaluate_surface = EvaluateSurface(Surface=reparameterize(rectangle.Rectangle), Point=md_slider)  # -> Point, Normal, UDirection, VDirection, Frame
circle = Circle(Plane=evaluate_surface.Point, Radius=radius_2)
divide_curve = DivideCurve(Curve=circle, Count=count_2, Kinks=False)  # -> Points, Tangents, Parameters
point_charge = PointCharge(Point=evaluate_surface.Point, Charge=Slider(0.4, range=0..1), Decay=Slider(1.1, range=0..10), Bounds=rectangle.Rectangle)
spin_force = SpinForce(
    Plane=evaluate_surface.Point,
    Strength=Slider(0.2, range=0..1),
    Radius=Slider(5.5, range=0..10),
    Decay=Slider(1.6, range=0..10),
    Bounds=rectangle.Rectangle)
merge_fields = MergeFields(Fields=[point_charge, spin_force])
field_line = FieldLine(Field=merge_fields, Point=divide_curve.Points, Steps=1000, Accuracy=0.1, Method=3)
divide_curve_2 = DivideCurve(Curve=field_line, Count=10, Kinks=False)  # -> Points, Tangents, Parameters
interpolate = Interpolate(Vertices=divide_curve_2.Points, Degree=3, Periodic=False, KnotStyle=1)  # -> Curve, Length, Domain
unit_z = UnitZ(Factor=Slider(0.7, range=0..1))
extrude = Extrude(Base=interpolate.Curve, Direction=unit_z)
mesh_brep = MeshBrep(
    Brep=extrude,
    Settings={GridMaxCount=0, GridMinCount=16, JaggedSeams=False, MaxEdgeLength=0, MinEdgeLength=0.0001, MinTolerance=0, Refine=True, RefineAngle=0, RelativeTolerance=0.65, SimplePlanes=True, Tolerance=0})
mesh_colours = MeshColours(Mesh=mesh_brep, Colours=ColourSwatch(SwatchColor=RGB(173, 109, 109)))

# ---- group: RH_OUT:mesh
mesh = Mesh(flatten(mesh_colours))
